# Grasshopper definition boxes.gh (Grasshopper 0.8.66)

int = Integer(0)
int_2 = Integer(0)
series = Series(Start=int, Step=Slider(0, range=0..10), Count=Slider(7, range=0..10))
panel = Panel(series)
series_2 = Series(Start=int_2, Step=Slider(2, range=0..10), Count=Slider(7, range=0..10))
panel_2 = Panel(series_2)
pt = PointXYZ(XComponent=panel_2, YComponent=panel, ZComponent=0, System=PlaneXY(0, 0, 0))
