# Grasshopper definition test[autosave].gh (Grasshopper 0.8.66)

slider = Slider(1, range=0..1)
pln = Plane(simplify(PlaneXY(0, 0, 0)))
fib = Fibonacci(SeedA=0, SeedB=1, Number=10)
pt = PointXYZ(XComponent=slider, YComponent=slider, ZComponent=slider, System=pln)
num = Number(graft(2))
circle = CircleCNR(Center=pt, Normal=Vector(0, 0, 1), Radius=num)
